# Dynamo graph Dynamo instance vars.dyn (Dynamo 2.17.0.3472)

code_block = CodeBlock { [1, 2]; [2, 1]; }
byCoordinates = Point.ByCoordinates(x=code_block.out0, y=code_block.out1)
code_block_2 = CodeBlock { ["red", "blue"]; }
assigning_instance_vars = Python(IN[0]=byCoordinates, IN[1]=code_block_2)  # CPython3
# ---------- assigning_instance_vars.python (8 lines) ----------
#Preparing input from dynamo to revit
elements = IN[0]
colors = IN[1]

OUT = []
for element, color in zip(elements, colors):
    element.color = color
    OUT.append(element.color)
# ----------------------------------------
wrapper_class = Python()  # CPython3
# ---------- wrapper_class.python (36 lines) ----------
#The BIM Coordinators Dynamo Python Template
#Subscribe to my YouTube: https://www.youtube.com/c/TheBIMCoordinator/featured
#Follow me on LinkedIn: https://www.linkedin.com/in/dalton-goodwin-067a07107/

import clr

clr.AddReference('ProtoGeometry')
from Autodesk.DesignScript.Geometry import Point

class ColoredPoint:
    def __init__(self, x, y, color):
        self.point = Point.ByCoordinates(x, y)
        self.color = color

    def coordinates(self):
        return f"({self.point.X}, {self.point.Y})"

    def colored_coordinates(self):
        return f"({self.point.X}, {self.point.Y}, color: {self.color})"

colored_point1 = ColoredPoint(2, 3, "red")
colored_point2 = ColoredPoint(4, 5, "blue")

OUT = colored_point1.coordinates(), colored_point1.colored_coordinates(), colored_point2.coordinates(), colored_point2.colored_coordinates() 



"""
class ColoredPoint(Point):
    def __init__(self, x, y, color):
        super().__init__(x, y)
        self.color = color

    def colored_coordinates(self):
        return f"({self.x}, {self.y}, color: {self.color})"
"""
# ----------------------------------------
class_vars = Python()  # CPython3; unwired: IN[0]
# ---------- class_vars.python (20 lines) ----------
class Point:
    def __init__(self, x, y, z):
        self.x = x
        self.y = y
        self.z = z
        
    def get_coordinates(self):
        return (self.x, self.y)
 


point1 = Point(1,2,3)
point2 = Point(4,5,6)

l = [point1, point2]

for i in l:
    i.coord = (0,0,0)
    
OUT = l[0].coord
# ----------------------------------------
