# Dynamo graph Logarithmic Spiral from a Golden Rectangle.dyn (Dynamo 2.13.0.3485)

file_path = Filename(".\FibonacciSpiral.svg.png")
file_from_path = FileObject(path=file_path)
readFromFile = Image.ReadFromFile(file=file_from_path)
watch_image = WatchImageCore(image=readFromFile)
number_slider = DoubleSlider(9, range=3..20 step 1)
python_script = Python(IN[0]=number_slider)  # CPython3
# ---------- python_script.python (23 lines) ----------
# Load the Python Standard and DesignScript Libraries
import sys
import clr
clr.AddReference('ProtoGeometry')
from Autodesk.DesignScript.Geometry import *


num_of_terms = int(IN[0]+1)

def fibonacci(n):
    a, b = 0, 1
    for i in range(n):
        a, b = b, a + b
    return a

def fibonacci_nums(num_of_terms):
    fib_list = []
    for i in range(num_of_terms):
        fib_list.append(fibonacci(i))
    return fib_list


OUT = fibonacci_nums(num_of_terms)
# ----------------------------------------
python_script_2 = Python(IN[0]=python_script)  # CPython3
# ---------- python_script_2.python (51 lines) ----------
# Load the Python Standard and DesignScript Libraries
import sys
import clr
clr.AddReference('ProtoGeometry')
from Autodesk.DesignScript.Geometry import *

n = IN[0]
n = n[2:]

last_num = n[:][-1]

r = ["x+ y-", "x- y-", "x- y+", "x+ y+"]

points = [Point.ByCoordinates(0, 0)]
lines = []

it = iter(r)
move_direction = next(it)
while n:
    
    if move_direction == r[-1]:
        it = iter(r)
    move_direction = next(it)

    if last_num == n[-1]:
        points.append(Point.ByCoordinates(points[-1].X + n[-2], points[-1].Y + n[-2]))
        lines.append(Line.ByStartPointDirectionLength(points[-1], Vector.ByCoordinates(0,-1,0), n[-2]))
        n = n[:-2]
        it = iter(r)


    elif move_direction == "x+ y-":
        points.append(Point.ByCoordinates(points[-1].X + n[-1], points[-1].Y - n[-1]))
        lines.append(Line.ByStartPointDirectionLength(points[-1], Vector.ByCoordinates(-1,0,0), n[-1]))
        n.pop(-1)
    elif move_direction == "x- y-":
        points.append(Point.ByCoordinates(points[-1].X - n[-1], points[-1].Y - n[-1]))
        lines.append(Line.ByStartPointDirectionLength(points[-1], Vector.ByCoordinates(0,1,0), n[-1]))
        n.pop(-1)
    elif move_direction == "x- y+":
        points.append(Point.ByCoordinates(points[-1].X - n[-1], points[-1].Y + n[-1]))
        lines.append(Line.ByStartPointDirectionLength(points[-1], Vector.ByCoordinates(1,0,0), n[-1]))
        n.pop(-1)
    elif move_direction == "x+ y+":
        points.append(Point.ByCoordinates(points[-1].X + n[-1], points[-1].Y + n[-1]))
        lines.append(Line.ByStartPointDirectionLength(points[-1], Vector.ByCoordinates(0,-1,0), n[-1]))
        n.pop(-1)
    
    
    
OUT = points, lines
# ----------------------------------------
code_block = CodeBlock(x=python_script_2) { x[0]; }
byPoints = NurbsCurve.ByPoints(points=code_block)
byGeometry = BoundingBox.ByGeometry(geom=code_block)
minPoint = BoundingBox.MinPoint(boundingBox=byGeometry)
maxPoint = BoundingBox.MaxPoint(boundingBox=byGeometry)
X = Point.X(point=maxPoint)
byCoordinates = Point.ByCoordinates(x=X)
Y = Point.Y(point=maxPoint)
byCoordinates_2 = Point.ByCoordinates(y=Y)
byCornerPoints = Rectangle.ByCornerPoints(p1=minPoint, p2=byCoordinates, p3=maxPoint, p4=byCoordinates_2)
