# Dynamo graph Tab Select Elements.dyn (Dynamo 2.12.0.5650)

force_get_active_selection = Python()  # IronPython2
# ---------- force_get_active_selection.python (24 lines) ----------
import clr

clr.AddReference('RevitServices')
import RevitServices
from RevitServices.Persistence import DocumentManager

doc = DocumentManager.Instance.CurrentDBDocument
uidoc=DocumentManager.Instance.CurrentUIApplication.ActiveUIDocument

"""
https://www.revitapidocs.com/2022/8eccaa93-cc99-fd37-15ad-24d201985d9b.htm

https://www.revitapidocs.com/2022/d9848d7d-5917-2433-8454-f65f5ac03964.htm
"""

def get_current_selection (uidoc):
	sel = uidoc.Selection
	return sel.GetElementIds()
	
selected_elements = []
for i in get_current_selection(uidoc):
	selected_elements.append(doc.GetElement(i))

OUT = selected_elements
# ----------------------------------------
# note: https://forum.dynamobim.com/t/how-to-force-nodes-to-rerun-without-changes-when-nodes-rerun/56366/3
python_script = Python()  # IronPython2
# ---------- python_script.python (24 lines) ----------
"""

C:\Program Files\Autodesk\Revit 2022\AddIns\DynamoForRevit

C:\Program Files\Autodesk\Revit 2022\AddIns\DynamoForRevit\Revit

"""

import clr
#clr.AddReference('ProtoGeometry')
#from Autodesk.DesignScript.Geometry import *

clr.AddReference('DynamoRevitDS')
import Dynamo
#access to the current Dynamo instance and workspace
dynamoRevit = Dynamo.Applications.DynamoRevit()
currentWorkspace = dynamoRevit.RevitDynamoModel.CurrentWorkspace

def onEvaluationcompleted(obj, e):
	for i in currentWorkspace.Nodes:
		if i.Name.StartsWith("*Force"):
			i.MarkNodeAsModified(True)
#the handlers for when a script has been run
currentWorkspace.EvaluationCompleted += onEvaluationcompleted
# ----------------------------------------
